# Grasshopper definition MakeKarambaModel.gh (Grasshopper 1.0.7)
# plug-ins: Karamba

pt = ConstructPoint(XCoordinate=Slider(5, range=0..10), YCoordinate=0, ZCoordinate=0)
pt_2 = ConstructPoint(XCoordinate=Slider(10, range=0..10), YCoordinate=0, ZCoordinate=0)
pt_3 = ConstructPoint(XCoordinate=0, YCoordinate=0, ZCoordinate=0)
Z = UnitZ(Factor=Slider(10, range=0..10))
neg = Negative(Value=Z)
ln = Line(StartPoint=pt_3, EndPoint=pt)
ln_2 = Line(StartPoint=pt, EndPoint=pt_2)
linetobeam = LineToBeamKaramba(Line=[ln, ln_2], New=True, Remove=True, LimitDistance_m=0.005)  # -> Element, Points, Info
supp = SupportKaramba(PosInd=pt_3, menu=[buttons(on, on, on, on, off, off)])
supp_2 = SupportKaramba(PosInd=pt_2, menu=[buttons(off, on, on, on, off, off)])
loads = LoadsKaramba(ForceVector=neg, Local=False, PosInd=pt, LCase=0, mode="Point")
assemble = AssembleModelKaramba(Elem=linetobeam.Element, Support=[supp, supp_2], Load=loads, LimitDistance_m=0.005)  # -> Model, Info, Mass_kg, CenterOfGravity
analyzethi = AnalyzeThIKaramba(Model=assemble.Model)  # -> CalculatedModel, MaximumDisplacement_m, ResultingForceOfGravity_kN, ElasticEnergy_kNm
modelview = ModelViewKaramba(Model=analyzethi.CalculatedModel, LoadCaseFactorsForLinearSuperposition=1, IndexOfVisibleLoadcase=-1)  # -> Model, DeformedMesh, DeformedAxes, DeformedModel
xz = XZPlane(Origin=Point(0, 0, 0))
X = UnitX(Factor=Slider(2, range=0..10))
rectangle = Rectangle(Plane=xz, XSize=Domain(-1, 1), YSize=Domain(-2, 2), Radius=0)  # -> Rectangle, Length
beamview = BeamViewKaramba(Model=modelview.Model)  # -> Model, MeshesOfRenderedBeams, DeformedBeamAxes, LegendColors, LegendTags
neg_2 = Negative(Value=X)
move = Move(Geometry=rectangle.Rectangle, Motion=neg_2)  # -> Geometry, Transform
legend = Legend(Colour=beamview.LegendColors, Tags=beamview.LegendTags, Rectangle=move.Geometry, LegendType=101)
