# Grasshopper definition Styly_BIMCompetition.gh (Grasshopper 1.0.7)
# plug-ins: Karamba, LunchBox

pt = ConstructPoint(XCoordinate=0, YCoordinate=Slider(2, range=0..10), ZCoordinate=0)
pt_2 = ConstructPoint(XCoordinate=0, YCoordinate=0, ZCoordinate=0)
pt_3 = ConstructPoint(XCoordinate=0, YCoordinate=Slider(1, range=0..10), ZCoordinate=0)
ln = Line(StartPoint=pt_2, EndPoint=pt_3)
ln_2 = Line(StartPoint=pt_3, EndPoint=pt)
Z = UnitZ(Factor=Slider(10, range=0..10))
neg = Negative(Value=Z)
supp = SupportKaramba(PosInd=[pt_2, pt], menu=[buttons(on, on, on, off, on, off)])
loads = LoadsKaramba(ForceVector=neg, Local=False, PosInd=pt_3, LCase=0, mode="Point")
linetobeam = LineToBeamKaramba(Line=[ln, ln_2], New=True, Remove=True, LimitDistance_m=0.005)  # -> Element, Points, Info
cross_sections = CrossSectionsKaramba(
    FamilyNameOfCrossSection="DefaultCroSec",
    Material=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,
    Height_cm=9.6,
    UpperFlangeWidth_cm=10,
    LowerFlangeWidth_cm=10,
    UpperFlangeThickness_cm=0.8,
    LowerFlangeThickness_cm=0.8,
    WebThickness_cm=0.5,
    FilletRadius_cm=0,
    mode="I")
assemble = AssembleModelKaramba(Elem=linetobeam.Element, Support=supp, Load=loads, CrossSection=cross_sections, LimitDistance_m=0.005)  # -> Model, Info, Mass_kg, CenterOfGravity
analyzethi = AnalyzeThIKaramba(Model=assemble.Model)  # -> CalculatedModel, MaximumDisplacement_m, ResultingForceOfGravity_kN, ElasticEnergy_kNm
modelview = ModelViewKaramba(Model=analyzethi.CalculatedModel, LoadCaseFactorsForLinearSuperposition=1, IndexOfVisibleLoadcase=-1)  # -> Model, DeformedMesh, DeformedAxes, DeformedModel
beamview = BeamViewKaramba(Model=modelview.Model)  # -> Model, MeshesOfRenderedBeams, DeformedBeamAxes, LegendColors, LegendTags

number_slider = Slider(10, range=0..10)
division = Division(A=number_slider, B=Slider(3, range=0..10))
subtraction = Subtraction(A=number_slider, B=division)
pt_4 = ConstructPoint(XCoordinate=0, YCoordinate=0, ZCoordinate=0)
pt_5 = ConstructPoint(XCoordinate=number_slider, YCoordinate=0, ZCoordinate=0)
pt_6 = ConstructPoint(XCoordinate=number_slider, YCoordinate=number_slider, ZCoordinate=0)
pt_7 = ConstructPoint(XCoordinate=0, YCoordinate=number_slider, ZCoordinate=0)
pt_8 = ConstructPoint(XCoordinate=division, YCoordinate=division, ZCoordinate=0)
pt_9 = ConstructPoint(XCoordinate=subtraction, YCoordinate=division, ZCoordinate=0)
pt_10 = ConstructPoint(XCoordinate=subtraction, YCoordinate=subtraction, ZCoordinate=0)
pt_11 = ConstructPoint(XCoordinate=division, YCoordinate=subtraction, ZCoordinate=0)
外柱始点 = Point([pt_4, pt_5, pt_6, pt_7])
内柱始点 = Point([pt_8, pt_9, pt_10, pt_11])
Z_2 = UnitZ(Factor=Slider(3, range=0..10))
move = Move(Geometry=外柱始点, Motion=Z_2)  # -> Geometry, Transform
move_2 = Move(Geometry=内柱始点, Motion=Z_2)  # -> Geometry, Transform
pt_12 = Point([move.Geometry, move_2.Geometry])

item = ListItem(List=pt_12, Index=Slider(1, range=0..100), Wrap=True)
item_2 = ListItem(List=pt_12, Index=Slider(2, range=0..100), Wrap=True)
item_3 = ListItem(List=pt_12, Index=Slider(5, range=0..100), Wrap=True)
item_4 = ListItem(List=pt_12, Index=Slider(6, range=0..100), Wrap=True)

item_5 = ListItem(List=pt_12, Index=Slider(0, range=0..100), Wrap=True)
item_6 = ListItem(List=pt_12, Index=Slider(1, range=0..100), Wrap=True)
item_7 = ListItem(List=pt_12, Index=Slider(4, range=0..100), Wrap=True)
item_8 = ListItem(List=pt_12, Index=Slider(5, range=0..100), Wrap=True)

item_9 = ListItem(List=pt_12, Index=Slider(2, range=0..100), Wrap=True)
item_10 = ListItem(List=pt_12, Index=Slider(3, range=0..100), Wrap=True)
item_11 = ListItem(List=pt_12, Index=Slider(6, range=0..100), Wrap=True)
item_12 = ListItem(List=pt_12, Index=Slider(7, range=0..100), Wrap=True)

item_13 = ListItem(List=pt_12, Index=Slider(3, range=0..100), Wrap=True)
item_14 = ListItem(List=pt_12, Index=Slider(0, range=0..100), Wrap=True)
item_15 = ListItem(List=pt_12, Index=Slider(7, range=0..100), Wrap=True)
item_16 = ListItem(List=pt_12, Index=Slider(4, range=0..100), Wrap=True)

shift = ShiftList(List=move.Geometry, Shift=1, Wrap=True)
shift_2 = ShiftList(List=move_2.Geometry, Shift=1, Wrap=True)

mjoin = MeshJoin(Meshes=beamview.MeshesOfRenderedBeams)
texture_file = Panel("C:\Users\hnatsume\Desktop\sb.png")
mesh = Mesh(mjoin)
c_script = CSharpScript(M=mesh, F=texture_file)  # -> out, A; inputs M: Mesh, F: String; disabled
# ---------- c_script: C# ----------
    A = BitmapFromVertexColors(M, F);
# ---------- c_script: C# additional code ----------
  Mesh BitmapFromVertexColors(Mesh mesh, string file)
  {
    mesh.Unweld(0, false);
    mesh.TextureCoordinates.Clear();

    for(int i = 0;i < mesh.Vertices.Count;i++)
      mesh.TextureCoordinates.Add(0, 0);

    int size = (int) Math.Ceiling(Math.Sqrt(mesh.Faces.Count));
    float fSize = (float) size * 2;

    Bitmap bitmap = new Bitmap(size * 2, size * 2);

    for(int i = 0;i < mesh.Faces.Count;i++)
    {
      MeshFace face = mesh.Faces[i];
      int x = (i % size) * 2;
      int y = (i / size) * 2;
      float fx = (float) x;
      float fy = (float) y;

      mesh.TextureCoordinates[face.A] = new Point2f((fx + 0.5) / fSize, (fy + 0.5) / fSize);
      mesh.TextureCoordinates[face.B] = new Point2f((fx + 1.5) / fSize, (fy + 0.5) / fSize);
      mesh.TextureCoordinates[face.C] = new Point2f((fx + 1.5) / fSize, (fy + 1.5) / fSize);
      mesh.TextureCoordinates[face.D] = new Point2f((fx + 0.5) / fSize, (fy + 1.5) / fSize);

      Color colorA = mesh.VertexColors[face.A];
      colorA = Color.FromArgb(255, colorA.R, colorA.G, colorA.B);
      Color colorB = mesh.VertexColors[face.B];
      colorB = Color.FromArgb(255, colorB.R, colorB.G, colorB.B);
      Color colorC = mesh.VertexColors[face.C];
      colorC = Color.FromArgb(255, colorC.R, colorC.G, colorC.B);
      Color colorD = mesh.VertexColors[face.D];
      colorD = Color.FromArgb(255, colorD.R, colorD.G, colorD.B);

      y = size * 2 - 2 - y;
      bitmap.SetPixel(x + 0, y + 1, colorA);
      bitmap.SetPixel(x + 1, y + 1, colorB);
      bitmap.SetPixel(x + 1, y + 0, colorC);
      bitmap.SetPixel(x + 0, y + 0, colorD);
    }

    bitmap.Save(file, System.Drawing.Imaging.ImageFormat.Png);
    return mesh;
  }
# ---------- end c_script ----------
mesh_2 = Mesh(c_script.A)

# ---- group: 柱
外柱 = Line(StartPoint=外柱始点, EndPoint=move.Geometry)
内柱 = Line(StartPoint=内柱始点, EndPoint=move_2.Geometry)

# ---- group: 梁
斜め梁 = Line(StartPoint=move_2.Geometry, EndPoint=move.Geometry)
外梁 = Line(StartPoint=move.Geometry, EndPoint=shift)
内梁 = Line(StartPoint=move_2.Geometry, EndPoint=shift_2)

# ---- group: 床
boundary = BoundarySurfaces(Edges=内梁)
srf4pt = _4PointSurface(CornerA=item_5, CornerB=item_6, CornerC=item_8, CornerD=item_7)
srf4pt_2 = _4PointSurface(CornerA=item, CornerB=item_2, CornerC=item_4, CornerD=item_3)
srf4pt_3 = _4PointSurface(CornerA=item_9, CornerB=item_10, CornerC=item_12, CornerD=item_11)
srf4pt_4 = _4PointSurface(CornerA=item_13, CornerB=item_14, CornerC=item_16, CornerD=item_15)

# ----
number_slider_2 = Slider(3, range=0..10)
number_slider_3 = Slider(10, range=0..10)
line = Line([外柱, 内柱])
line_2 = Line([外梁, 内梁])
srf = Surface([boundary, srf4pt, srf4pt_2, srf4pt_3, srf4pt_4])
area = Area(Geometry=boundary)  # -> Area, Centroid
Z_3 = UnitZ(Factor=1)
tria = TriangularPanelsA(Surface=srf, UDivisions=number_slider_2, VDivisions=number_slider_2)
line_3 = LineSDL(Start=area.Centroid, Direction=Z_3, Length=Slider(33, range=0..100))
arrlinear = LinearArray(Geometry=line, Direction=Z_2, Count=number_slider_3)  # -> flatten(Geometry), Transform
arrlinear_2 = LinearArray(Geometry=line_2, Direction=Z_2, Count=number_slider_3)  # -> flatten(Geometry), Transform
arrlinear_3 = LinearArray(Geometry=斜め梁, Direction=Z_2, Count=number_slider_3)  # -> flatten(Geometry), Transform
arrlinear_4 = LinearArray(Geometry=tria, Direction=Z_2, Count=number_slider_3)  # -> flatten(Geometry), Transform
line_4 = Line([arrlinear.Geometry, arrlinear_2.Geometry, arrlinear_3.Geometry])
lng = ListLength(List=flatten([line, line_2, 斜め梁]))
twist = Twist(Geometry=[line_4, arrlinear_4.Geometry], Axis=line_3, Angle=1.570796327, Infinite=Toggle(True), Rigid=False)
lng_2 = ListLength(List=line)
multiplication = Multiplication(A=lng, B=number_slider_3)
multiplication_2 = Multiplication(A=lng_2, B=number_slider_3)
split = SplitList(List=twist, Index=multiplication)  # -> ListA, ListB
series = Series(Start=0, Step=Slider(11, range=0..100), Count=Slider(8, range=0..10))
split_2 = SplitList(List=split.ListA, Index=multiplication_2)  # -> ListA, ListB
number_slider_4 = Slider(30, range=0..100)
number_slider_5 = Slider(2.2, range=0..10)
number_slider_6 = Slider(40, range=0..100)
number_slider_7 = Slider(0.2, range=0..10)
cross_sections_2 = CrossSectionsKaramba(
    FamilyNameOfCrossSection="DefaultCroSec",
    Material=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,
    Height_cm=Slider(50, range=0..100),
    UpperFlangeWidth_cm=number_slider_4,
    LowerFlangeWidth_cm=number_slider_4,
    UpperFlangeThickness_cm=number_slider_5,
    LowerFlangeThickness_cm=number_slider_5,
    WebThickness_cm=0.5,
    FilletRadius_cm=0,
    mode="I")
cross_sections_3 = CrossSectionsKaramba(
    FamilyNameOfCrossSection="DefaultCroSec",
    Material=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,
    Height_cm=number_slider_6,
    UpperFlangeWidth_cm=number_slider_6,
    LowerFlangeWidth_cm=number_slider_6,
    UpperFlangeThickness_cm=number_slider_7,
    LowerFlangeThickness_cm=number_slider_7,
    SidewallsThickness_cm=number_slider_7,
    FilletRadius_cm=0.6,
    mode="Box")
Z_4 = UnitZ(Factor=1)
X = UnitX(Factor=Slider(0.3, range=0..1))
Y = UnitY(Factor=Slider(0.3, range=0..1))
neg_2 = Negative(Value=Z_4)
loads_2 = LoadsKaramba(Vector=Y, LCase=Slider(2, range=0..100), mode="Gravity")
loads_3 = LoadsKaramba(Vector=neg_2, LCase=Slider(0, range=0..100), mode="Gravity")
loads_4 = LoadsKaramba(Vector=X, LCase=Slider(1, range=0..100), mode="Gravity")
柱モデル化 = LineToBeamKaramba(Line=split_2.ListA, Identifier="columm", CrossSection=cross_sections_3, New=True, Remove=True, LimitDistance_m=0.005)  # -> Element, Points, Info
item_17 = ListItem(List=柱モデル化.Points, Index=series, Wrap=True)
supp_2 = SupportKaramba(PosInd=item_17, menu=[buttons(on, on, on, off, off, off)])
梁モデル化 = LineToBeamKaramba(Line=split_2.ListB, Identifier="beam", CrossSection=cross_sections_2, New=True, Remove=True, LimitDistance_m=0.005)  # -> Element, Points, Info
床モデル化 = MeshToShellKaramba(Mesh=split.ListB, LimitDistance_m=0.005)  # -> Element, Points, Info
load = LoadKaramba([loads_3, loads_4, loads_2])
assemble_2 = AssembleModelKaramba(Elem=flatten([柱モデル化.Element, 梁モデル化.Element]), Support=supp_2, Load=load, LimitDistance_m=0.005)  # -> Model, Info, Mass_kg, CenterOfGravity
analyzethi_2 = AnalyzeThIKaramba(Model=assemble_2.Model)  # -> CalculatedModel, MaximumDisplacement_m, ResultingForceOfGravity_kN, ElasticEnergy_kNm
panel = Panel(柱モデル化.Points)
modelview_2 = ModelViewKaramba(Model=analyzethi_2.CalculatedModel, LoadCaseFactorsForLinearSuperposition=1, IndexOfVisibleLoadcase=-1)  # -> Model, DeformedMesh, DeformedAxes, DeformedModel
beamview_2 = BeamViewKaramba(Model=modelview_2.Model)  # -> Model, MeshesOfRenderedBeams, DeformedBeamAxes, LegendColors, LegendTags
shellview = ShellViewKaramba(Model=modelview_2.Model, IndexOfLayer=0)  # -> Model, MeshesOfRenderedShells, LegendColors, LegendTags; disabled
mjoin_2 = MeshJoin(Meshes=beamview_2.MeshesOfRenderedBeams)
mjoin_3 = MeshJoin(Meshes=shellview.MeshesOfRenderedShells)  # disabled
texture_file_2 = Panel("C:\Users\hnatsume\Desktop\beam.png")
texture_file_3 = Panel("C:\Users\hnatsume\Desktop\mesh.png")  # disabled
mesh_3 = Mesh(mjoin_2)
mesh_4 = Mesh(mjoin_3)  # disabled
c_script_2 = CSharpScript(M=mesh_3, F=texture_file_2)  # -> out, A; inputs M: Mesh, F: String; same code as c_script
c_script_3 = CSharpScript(M=mesh_4, F=texture_file_3)  # -> out, A; inputs M: Mesh, F: String; disabled; same code as c_script
mesh_5 = Mesh(c_script_3.A)  # disabled

# ---- group: bake mesh
mesh_6 = Mesh(c_script_2.A)
