# Grasshopper definition T03_ViveTrack_and_Kangaroo.gh (Grasshopper 1.0.7)
# plug-ins: Kangaroo2 Components, ViveTrack

startvive = StartVive(AutoUpdate=True)  # -> Msg, Vive
controller1 = Controller1(Vive=startvive.Vive, Pause=False)  # -> Controller, Plane, Matrix, TriggerState, TouchPadState
controller2 = Controller2(Vive=startvive.Vive, Pause=False)  # -> Controller, Plane, Matrix, TriggerState, TouchPadState
hmd = ViveHMD(Vive=startvive.Vive, Pause=False)  # -> HMD, Plane, Matrix
scale = Scale(Geometry=controller1.Plane, Center=Point(0, 0, 0), Factor=Slider(44, range=0..100))  # -> Geometry, Transform
sph = Sphere(Base=scale.Geometry, Radius=Slider(8, range=0..100))
scale_2 = Scale(Geometry=controller2.Plane, Center=Point(0, 0, 0), Factor=Slider(44, range=0..100))  # -> Geometry, Transform
sph_2 = Sphere(Base=scale_2.Geometry, Radius=Slider(8, range=0..100))
scale_3 = Scale(Geometry=hmd.Plane, Center=Point(0, 0, 0), Factor=Slider(44, range=0..100))  # -> Geometry, Transform
sph_3 = Sphere(Base=scale_3.Geometry, Radius=Slider(8, range=0..100))

brep = Brep([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])
brep_2 = Brep(flatten([brep, sph, sph_2, sph_3]))

reset = Button()
run = BooleanToggle(False)

crossref = CrossReference(ListA=brep_2, ListB=brep_2, CrossMode=5)  # -> graft(ListA), graft(ListB)
mesh = Mesh([crossref.ListA, crossref.ListB])
debrep = DeconstructBrep(Brep=brep_2)  # -> Faces, Edges, Vertices
item = ListItem(List=mesh, Index=0, Wrap=True)  # -> Item, Item1
solidplanecollide = SolidPlaneCollide(Solid=brep_2, CollisionPlane=PlaneXY(0, 0, 0), Strength=3)
rigidbody = RigidBody(Part=graft(brep_2), Points=debrep.Vertices, Strength=3)  # -> RigidBody, Planes
solidcollide = SolidCollide(MeshA=item.Item, MeshB=item.Item1, Strength=Slider(10, range=0..10))
solver_bouncy = SolverBouncy(
    GoalObjects=[solidplanecollide, solidcollide, rigidbody.RigidBody],
    Reset=reset,
    Threshold=1e-08,
    Tolerance=0.01,
    Damping=0.98,
    Iterations=15,
    On=run)  # -> I, V, O
mesh_2 = Mesh(solver_bouncy.O)
edges = BrepEdges(Brep=solver_bouncy.O)  # -> Naked, Interior, NonManifold
colourful = Colourful(geo=mesh_2)

# ==== cluster Colourful: Display objects in bright colours
geo = ClusterInput()
geo_2 = Geometry(geo)
clean = CleanTree(RemoveNulls=True, RemoveInvalid=True, RemoveEmpty=False, Tree=flatten(geo_2))
S = Shader([{diffuse=RGB(11, 125, 222), emission=RGB(3, 38, 67), shine=0.5, specular=RGB(255, 255, 255), transparency=0}, {diffuse=RGB(222, 37, 11), emission=RGB(67, 11, 3), shine=0.5, specular=RGB(255, 255, 255), transparency=0}, {diffuse=RGB(71, 222, 11), emission=RGB(21, 67, 3), shine=0.5, specular=RGB(255, 255, 255), transparency=0}, {diffuse=RGB(222, 194, 11), emission=RGB(67, 58, 3), shine=0.5, specular=RGB(255, 255, 255), transparency=0}])
lng = ListLength(List=clean)
repeat = RepeatData(Data=S, Length=lng)
preview = CustomPreview(Geometry=clean, Shader=repeat)
