# Grasshopper definition gridshelf.gh (Grasshopper 1.0.7)
# plug-ins: Karamba, LunchBox

number_slider = Slider(0, range=0..100)
dom = ConstructDomain(DomainStart=number_slider, DomainEnd=Slider(5, range=0..10))
dom_2 = ConstructDomain(DomainStart=number_slider, DomainEnd=Slider(5, range=0..10))
rectangle = Rectangle(Plane=PlaneXY(0, 0, 0), XSize=dom, YSize=dom_2, Radius=0)  # -> Rectangle, Length
boundary = BoundarySurfaces(Edges=rectangle.Rectangle)

# ----
# divisions
number_slider_2 = Slider(8, range=0..10)
number_slider_3 = Slider(10, range=0..10)

quads = QuadPanels(Surface=boundary, UDivisions=number_slider_2, VDivisions=number_slider_3)
lng = ListLength(List=quads)
# make panel
number_slider_4 = Slider(88, range=0..100)
multiplication = Multiplication(A=lng, B=Slider(0.6, range=0..1))
number_slider_5 = Slider(4, range=0..10)
reduce = RandomReduce(List=quads, Reduction=multiplication, Seed=number_slider_4)
quads_2 = QuadPanels(Surface=reduce, UDivisions=number_slider_5, VDivisions=number_slider_5)

# ----
# galapagos
galapagos = Galapagos(fitness=num, gene=number_slider_4)
# make frame
grid = GridStructure(Surface=boundary, UDivisions=number_slider_2, VDivisions=number_slider_3)  # -> StructureLines, StructureNodes

md_slider = MDSlider(SliderMode=0, slider_value=Point(0, 0, 0.5), x_domain=Domain(0, 1), y_domain=Domain(0, 1), z_domain=Domain(0, 1))
md_slider_2 = MDSlider(SliderMode=0, slider_value=Point(1, 0, 0.5), x_domain=Domain(0, 1), y_domain=Domain(0, 1), z_domain=Domain(0, 1))
evalsrf = EvaluateSurface(Surface=reparameterize(boundary), Point=md_slider)  # -> Point, Normal, UDirection, VDirection, Frame
evalsrf_2 = EvaluateSurface(Surface=reparameterize(boundary), Point=md_slider_2)  # -> Point, Normal, UDirection, VDirection, Frame

number_slider_6 = Slider(2, range=0..10)
cross_sections = CrossSectionsKaramba(
    FamilyNameOfCrossSection="DefaultCroSec",
    Material=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,
    Height_cm=Slider(30, range=0..1000),
    UpperFlangeWidth_cm=number_slider_6,
    LowerFlangeWidth_cm=number_slider_6,
    UpperFlangeThickness_cm=number_slider_6,
    LowerFlangeThickness_cm=number_slider_6,
    WebThickness_cm=number_slider_6,
    FilletRadius_cm=number_slider_6,
    mode="I")

X = UnitX(Factor=Slider(10, range=0..10))
loads = LoadsKaramba(Vector=X, LCase=0, mode="Gravity")

linetobeam = LineToBeamKaramba(Line=grid.StructureLines, New=True, Remove=True, LimitDistance_m=0.005)  # -> Element, Points, Info
meshtoshell = MeshToShellKaramba(Mesh=quads_2, LimitDistance_m=0.005)  # -> Element, Points, Info
# karamba
element = ElementKaramba(flatten([meshtoshell.Element, linetobeam.Element]))

supp = SupportKaramba(PosInd=[evalsrf.Point, evalsrf_2.Point], menu=[buttons(on, on, on, on, off, off)])
assemble = AssembleModelKaramba(Elem=element, Support=supp, Load=loads, CrossSection=cross_sections, LimitDistance_m=0.005)  # -> Model, Info, Mass_kg, CenterOfGravity
analyzethi = AnalyzeThIKaramba(Model=assemble.Model)  # -> CalculatedModel, MaximumDisplacement_m, ResultingForceOfGravity_kN, ElasticEnergy_kNm
num = Number(analyzethi.MaximumDisplacement_m)

modelview = ModelViewKaramba(Model=analyzethi.CalculatedModel, LoadCaseFactorsForLinearSuperposition=1, IndexOfVisibleLoadcase=-1)  # -> Model, DeformedMesh, DeformedAxes, DeformedModel
shellview = ShellViewKaramba(Model=modelview.Model, IndexOfLayer=0)  # -> Model, MeshesOfRenderedShells, LegendColors, LegendTags
beamview = BeamViewKaramba(Model=modelview.Model)  # -> Model, MeshesOfRenderedBeams, DeformedBeamAxes, LegendColors, LegendTags
